# Grasshopper definition 01_GlideReflection.gh (Grasshopper 1.0.8)

sqgrid = Square(Plane=PlaneXY(0, 0, 0), Size="30", ExtentX="10", ExtentY="10")  # -> Cells, Points

# ---- group: Create horizontal divider
explode = Explode(Curve=sqgrid.Cells, Recursive=True)  # -> Segments, Vertices
dispatch = Dispatch(List=explode.Segments, DispatchPattern=[True, False])  # -> ListA, ListB
midpt = CurveMiddle(Curve=dispatch.ListB)
pline = PolyLine(Vertices=midpt, Closed=False)

# ----
weave = Weave(Pattern=[0, 1], Stream0=dispatch.ListA, Stream1=pline, NullGaps=False)
rev = ReverseList(List=weave)
