# Grasshopper definition 03_Hubermann.gh (Grasshopper 1.0.8)

cir = Circle(Plane=PlaneXY(0, 0, 0), Radius="90")
cir_2 = Circle(Plane=PlaneXY(0, 0, 0), Radius="120")
cir_3 = Circle(Plane=PlaneXY(0, 0, 0), Radius="150")

divide = DivideCurve(Curve=reparameterize(cir), Count=Slider(15, range=10..20), Kinks=False)  # -> Points, Tangents, Parameters
addition = Addition(A=divide.Parameters, B=Slider(0, range=0..1))
eval = EvaluateCurve(Curve=reparameterize(cir_2), Parameter=addition)  # -> Point, Tangent, Angle
eval_2 = EvaluateCurve(Curve=reparameterize(cir_3), Parameter=divide.Parameters)  # -> Point, Tangent, Angle
merge = Merge(Data1=graft(divide.Points), Data2=graft(eval.Point), Data3=graft(eval_2.Point))
pline = PolyLine(Vertices=merge, Closed=False)
