# Grasshopper definition 04_radialfolding.gh (Grasshopper 1.0.8)
# plug-ins: eleFront

number_slider = Slider(38, range=0..200)
number_slider_2 = Slider(154, range=0..200)
subtraction = Subtraction(A=number_slider_2, B=number_slider)
X = UnitX(Factor=1)
pt = ConstructPoint(XCoordinate=number_slider, YCoordinate=0, ZCoordinate=0)

cir = Circle(Plane=PlaneXY(0, 0, 0), Radius=number_slider_2)
line = LineSDL(Start=pt, Direction=X, Length=subtraction)
cir_2 = Circle(Plane=PlaneXY(0, 0, 0), Radius=number_slider)

arrpolar = PolarArray(Geometry=line, Plane=PlaneXY(0, 0, 0), Count=Slider(18, range=5..30), Angle=6.283185307)  # -> Geometry, Transform
divide = DivideCurve(Curve=arrpolar.Geometry, Count=10, Kinks=False)  # -> Points, Tangents, Parameters
dash = DashPattern(Curve=arrpolar.Geometry, Pattern="2")  # -> Dashes, Gaps
tstat = TreeStatistics(Tree=dash.Dashes)  # -> Paths, Length, Count
dispatch = Dispatch(List=tstat.Paths, DispatchPattern=[True, False])  # -> ListA, ListB
flip = FlipMatrix(Data=divide.Points)
pline = PolyLine(Vertices=flip, Closed=invert(False))
branch = TreeBranch(Tree=dash.Dashes, Path=dispatch.ListA, MaintainPaths=True)
branch_2 = TreeBranch(Tree=dash.Dashes, Path=dispatch.ListB, MaintainPaths=True)
dispatch_2 = Dispatch(List=branch, DispatchPattern=[True, False])  # -> ListA, ListB
dispatch_3 = Dispatch(List=branch_2, DispatchPattern=[True, False])  # -> ListA, ListB

crv_radialbase2 = EleFrontDataDescription(dispatch_3.ListB, ShiftDepth=0, isNameSet=True)
crv_radialbase1 = EleFrontDataDescription(dispatch_2.ListA, ShiftDepth=0, isNameSet=True)

crv_radialbase2_2 = EleFrontDataDescription(crv_radialbase2, ShiftDepth=0, isNameSet=False)
crv_radialbase1_2 = EleFrontDataDescription(crv_radialbase1, ShiftDepth=0, isNameSet=False)
